# Grasshopper definition GHCitySim.ghx (Grasshopper 0.9.76)
# plug-ins: Python Interpreter

ladybug = Ladybug_Ladybug()  # -> Vviiiiiiiiiizzz; plug-in component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
honeybee = Honeybee_Honeybee()  # -> Vviiiiiiiiiizzz; plug-in component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
number_slider = Slider(2, range=0..10)
panel = Panel("""0
1""")

# ---- group: Testing area (for Aymeric)
box = CenterBox(Base=PlaneXY(0, 0, 0), X=1, Y=1, Z=1)
brep = Brep(box)
bldgprograms = Honeybee_bldgPrograms({"Office": 0, "Retail": 1, "MidriseApartment": 2, "PrimarySchool": 3, "SecondarySchool": 4, "SmallHotel": 5, "LargeHotel": 6, "Hospital": 7, "Outpatient": 8, "Warehouse": 9, "SuperMarket": 10, "FullServiceRestaurant": 11, "QuickServiceRestaurant": 12}, selected="Office")
createhbsrfs = Honeybee_createHBSrfs(geometry=brep)  # -> readMe, simplify(HBSurface); plug-in component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
createhbzones = Honeybee_createHBZones(name="test", zoneProgram=bldgprograms, HBSurfaces=flatten(createhbsrfs.HBSurface), isConditioned=True)  # -> readMe, HBZone; plug-in component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
panel_2 = Panel("ASHRAE 189.1-2009 EXTROOF IEAD CLIMATEZONE 1")
setepzonecnstr = Honeybee_SetEPZoneConstruction(
    HBZone=createhbzones.HBZone,
    wallEPConstruction="ASHRAE 189.1-2009 EXTWALL MASS CLIMATEZONE 1",
    roofEPConstruction=panel_2,
    floorEPConstruction=panel_2,
    expFloorEPConstruction=panel_2)  # -> simplify(modifiedHBZone); plug-in component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
citysim_checkmaterials = CitySimCheckMaterials(HBZones=flatten(setepzonecnstr))  # -> out; inputs HBZones: list of Brep
# ---------- citysim_checkmaterials: Python ----------
#Extract material properties
#GH-Citysim working component


ghenv.Component.Name = "CitySim-CheckMaterials"
ghenv.Component.NickName = 'CitySim-CheckMaterials'
ghenv.Component.Message = 'WORKING COMPONENT'
ghenv.Component.IconDisplayMode = ghenv.Component.IconDisplayMode.application
ghenv.Component.Category = "Honeybee"
ghenv.Component.SubCategory = "09 | Energy | Energy"
#compatibleHBVersion = VER 0.0.56\nFEB_03_2016
#compatibleLBVersion = VER 0.0.59\nFEB_01_2015
ghenv.Component.AdditionalHelpFromDocStrings = "1"


import Rhino as rc
import scriptcontext as sc
import rhinoscriptsyntax as rs
import os
import System
import Grasshopper.Kernel as gh
import math
import shutil
import collections
import subprocess
import copy

rc.Runtime.HostUtils.DisplayOleAlerts(False)


    
lb_preparation = sc.sticky["ladybug_Preparation"]()
hb_reEvaluateHBZones= sc.sticky["honeybee_reEvaluateHBZones"]
hb_hive = sc.sticky["honeybee_Hive"]()
hb_EPScheduleAUX = sc.sticky["honeybee_EPScheduleAUX"]()
hb_EPPar = sc.sticky["honeybee_EPParameters"]()
    
#EPConstructions = sc.sticky ["honeybee_constructionLib"].keys()
       
def EPConstructionStr(constructionName):
        constructionData = None
        if constructionName in sc.sticky ["honeybee_constructionLib"].keys():
            constructionData = sc.sticky ["honeybee_constructionLib"][constructionName]
        
        if constructionData!=None:
            materials = []
            numberOfLayers = len(constructionData.keys())
            constructionStr = constructionData[0] + ",\n"
            # add the name
            constructionStr =  constructionStr + "  " + constructionName + ",   !- name\n"
            
            for layer in range(1, numberOfLayers):
                if layer < numberOfLayers-1:
                    constructionStr =  constructionStr + "  " + constructionData[layer][0] + ",   !- " +  constructionData[layer][1] + "\n"
                else:
                    constructionStr =  constructionStr + "  " + constructionData[layer][0] + ";   !- " +  constructionData[layer][1] + "\n\n"
                materials.append(constructionData[layer][0])
                
            return materials
        else:
            warning = "Failed to find " + constructionName + " in library."
            print warning
            ghenv.Component.AddRuntimeMessage(gh.GH_RuntimeMessageLevel.Warning, warning)
            return None, None

        
 
def getMaterialProperties(matName):
    if not sc.sticky["honeybee_release"]:
        print "You should first let Honeybee to fly..."
        w = gh.GH_RuntimeMessageLevel.Warning
        ghenv.Component.AddRuntimeMessage(w, "You should first let Honeybee to fly...")
        return -1

    try:
        if not sc.sticky['honeybee_release'].isCompatible(ghenv.Component): return -1
        if sc.sticky['honeybee_release'].isInputMissing(ghenv.Component): return -1
    except:
        warning = "You need a newer version of Honeybee to use this compoent." + \
        " Use updateHoneybee component to update userObjects.\n" + \
        "If you have already updated userObjects drag Honeybee_Honeybee component " + \
        "into canvas and try again."
        w = gh.GH_RuntimeMessageLevel.Warning
        ghenv.Component.AddRuntimeMessage(w, warning)
        return -1
    
    # get the constuction
    try:
        hb_EPMaterialAUX = sc.sticky["honeybee_EPMaterialAUX"]()
    except:
        msg = "Failed to load EP constructions!"
        ghenv.Component.AddRuntimeMessage(w, msg)
        return -1
    
    if sc.sticky.has_key("honeybee_materialLib"):
        result = hb_EPMaterialAUX.decomposeMaterial(matName.upper(), ghenv.Component)
        if result == -1:
            warning = "Failed to find " + matName + " in the Honeybee material library."
            print warning
            ghenv.Component.AddRuntimeMessage(gh.GH_RuntimeMessageLevel.Warning, warning)
        return result
        

    
# call the objects from the lib
thermalZonesPyClasses = hb_hive.callFromHoneybeeHive(_HBZones)
 

for zone in thermalZonesPyClasses:

        schedules = zone.getCurrentSchedules(True)
        loads = zone.getCurrentLoads(True)
             
        for srf in zone.surfaces:
            if srf.EPConstruction != None:
                srf.construction = srf.EPConstruction
                print 'ID', EPConstructions.index(srf.construction)
                materials = EPConstructionStr(srf.construction)
                print "Solar reflectivity : ",str(1-float(getMaterialProperties(materials[-1])[0][-2]))
                #print "\n"
# ---------- end citysim_checkmaterials ----------
panel_3 = Panel(citysim_checkmaterials)

# ----
brep_2 = Brep([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])
number_slider_2 = Slider(80, range=0..100)
item = ListItem(List=brep_2, Index=panel, Wrap=True)
custom_mesh_settings = SettingsCustom(
    StitchSeams=True,
    SimplePlanes=False,
    Refine=True,
    MinCount=0,
    MaxCount=0,
    AspectRatio=20,
    MaxDistance=0,
    MaxAngle=20,
    MinEdge=number_slider,
    MaxEdge=number_slider)
mesh = MeshBrep(Brep=brep_2, Settings=custom_mesh_settings)
separatebynormal = Honeybee_SeparateByNormal(geometry=brep_2, maxUpDecAngle=number_slider_2, maxDownDecAngle=number_slider_2)  # -> simplify(lookingUp), simplify(lookingDown), simplify(lookingSide); plug-in component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
exportladybug = Ladybug_ExportLadybug(components="*", targetFolder="C:\Users\peronato\Documents\GitHub\GHCitySim", export=Toggle(False))  # -> readMe; plug-in component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
faceb = FaceBoundaries(Mesh=mesh)  # -> simplify(Boundaries)
srf = Surface(faceb)
epnomassmat = Honeybee_EnergyPlusNoMassOpaqueMaterial(name="floor", R_Value=Slider(1, range=0..1), solAbsp=Slider(0.9, range=0..1))  # -> EPMaterial; plug-in component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
epnomassmat_2 = Honeybee_EnergyPlusNoMassOpaqueMaterial(name="roof", R_Value=Slider(1, range=0..1), solAbsp=Slider(0.3, range=0..1))  # -> EPMaterial; plug-in component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
createhbsrfs_2 = Honeybee_createHBSrfs(geometry=srf)  # -> readMe, simplify(HBSurface); plug-in component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
mass2zone = Honeybee_Masses2Zones(zoneMasses=flatten(item), isConditioned=True, maxRoofAngle=30, createHBZones=Toggle(True))  # -> readMe, HBZones; plug-in component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
tstat = TreeStatistics(Tree=srf)  # -> Paths, Length, Count
epnomassmat_3 = Honeybee_EnergyPlusNoMassOpaqueMaterial(name="facade", R_Value=Slider(1, range=0..1), solAbsp=Slider(0.9, range=0..1))  # -> EPMaterial; plug-in component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
epconstruction = Honeybee_EnergyPlusConstruction(name="customfloor", layer_1=epnomassmat)  # -> EPConstruction; plug-in component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
epconstruction_2 = Honeybee_EnergyPlusConstruction(name="customroof", layer_1=epnomassmat_2)  # -> EPConstruction; plug-in component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
epconstruction_3 = Honeybee_EnergyPlusConstruction(name="customfacade", layer_1=epnomassmat_3)  # -> EPConstruction; plug-in component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
createhbzones_2 = Honeybee_createHBZones(name=tstat.Paths, HBSurfaces=flatten(createhbsrfs_2.HBSurface), isConditioned=True)  # -> readMe, simplify(HBZone); plug-in component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
vertical = Panel("""10
10
10
10
10""")
horiziontal = Panel("""0
90
180
270
360""")
context = Brep([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])
addtoeplibrary = Honeybee_AddToEnergyPlusLibrary(EPObject=[epconstruction_2, epconstruction, epconstruction_3], addToProjectLib=Toggle(False))  # -> readMe; plug-in component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
callfromepconstrlibrary = Honeybee_CallFromEPConstructionLibrary()  # -> ThermMaterials, EPMaterials, EPWindowMaterials, EPConstructions; plug-in component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
terrain_mesh = Mesh(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)
smesh = SimpleMesh(Brep=context)
createhbsrfs_3 = Honeybee_createHBSrfs(geometry=separatebynormal.lookingUp, srfType=Slider(1, range=0..1), EPConstruction=epconstruction_2)  # -> readMe, simplify(HBSurface); plug-in component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
createhbsrfs_4 = Honeybee_createHBSrfs(geometry=separatebynormal.lookingDown, srfType=Slider(2.5, range=0..10), EPConstruction=epconstruction)  # -> readMe, simplify(HBSurface); plug-in component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
createhbsrfs_5 = Honeybee_createHBSrfs(geometry=separatebynormal.lookingSide, srfType=Slider(0, range=0..100), EPConstruction=epconstruction_3)  # -> readMe, simplify(HBSurface); plug-in component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
path = FilePath("C:\Users\peronato\Desktop\CitySimGH\")
path_2 = FilePath(path)
path_3 = FilePath(path)
path_4 = FilePath(path)
preview = CustomPreview(Geometry=terrain_mesh, Shader=ColourSwatch(SwatchColor=RGB(255, 255, 255)))
zones_with_detailed_mesh = Data(createhbzones_2.HBZone)
simplified_zones = Data(mass2zone.HBZones)
epw_path = FilePath("C:\Users\peronato\Documents\WeatherFiles\Neuchatel-hour.epw")
panel_4 = Panel(callfromepconstrlibrary.EPConstructions)
path_5 = FilePath(path)
epw_to_clim = Ladybug_EpwToClim(epwFile=epw_path, path=path_5, Run=Toggle(False))  # -> out, climatefile; plug-in component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
path_mapper = PathMapper(createhbsrfs_5.HBSurface, source=["{A}", "{A;B}", "{A;B;C}"], target=["{A}", "{A}", "{A}"])
path_mapper_2 = PathMapper(createhbsrfs_4.HBSurface, source=["{A}", "{A;B}", "{A;B;C}"], target=["{A}", "{A}", "{A}"])
path_mapper_3 = PathMapper(createhbsrfs_3.HBSurface, source=["{A}", "{A;B}", "{A;B;C}"], target=["{A}", "{A}", "{A}"])
crv = Curve(srf)
lng = ListLength(List=flatten(crv))
climate_file = Text(epw_to_clim.climatefile)
clean = CleanTree(RemoveNulls=True, RemoveInvalid=True, RemoveEmpty=False, Tree=[path_mapper_3, path_mapper_2, path_mapper])
panel_5 = Panel("""0.5
0.3
0.45
0""")
panel_6 = Panel("""0.5
0.3
0.45
0.0""")
name = Text("test")
name_2 = Text(name)
name_3 = Text(name)
name_4 = Text(name)
citysim_horizon = Honeybee_CitySimHorizon(H=horiziontal, V=vertical, path=path_4, name=name_4, Write=Toggle(False))  # -> out; plug-in component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
citysim_srf = Honeybee_CitySimSrf(S=smesh, R=Slider(0.2, range=0..1), path=path_3, name=name_3, Write=Toggle(False))  # -> out; plug-in component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
citysim_srf_2 = Honeybee_CitySimSrf(
    S=terrain_mesh,
    R=Slider(0.1, range=0..1),
    type="terrain",
    Dup=Toggle(False),
    path=path_2,
    name=name_2,
    Write=Toggle(False))  # -> out; plug-in component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
dup = DuplicateData(Data=Slider(0.2, range=0..1), Number=lng, Order=True)
createhbzones_3 = Honeybee_createHBZones(name=tstat.Paths, HBSurfaces=flatten(clean), isConditioned=True)  # -> readMe, simplify(HBZone); plug-in component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
decomposeepconstruction = Honeybee_DecomposeEPConstruction(cnstrName="CUSTOMROOF")  # -> materials, comments, UValue_SI, UValue_IP, RValue_SI, RValue_IP; plug-in component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
unflatten = UnflattenTree(Tree=dup, Guide=crv)
callfromepschlibrary = Honeybee_CallFromEPScheduleLibrary()  # -> scheduleTypeLimits, scheduleList; plug-in component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
entwine = Entwine(Branch00=panel_5, Branch01=panel_5, Branch02=panel_5, FlattenInputs=True)  # -> simplify(Result)
python = PythonScript(geometry=flatten(crv))  # -> out, a; inputs geometry: tree of Polyline
# ---------- python: Python ----------
# written by Giulio Piacentino, giulio@mcneel.com
def tree_to_list(input, retrieve_base = lambda x: x[0]):
    """Returns a list representation of a Grasshopper DataTree"""
    def extend_at(path, index, simple_input, rest_list):
        target = path[index]
        if len(rest_list) <= target: rest_list.extend([None]*(target-len(rest_list)+1))
        if index == path.Length - 1:
            rest_list[target] = list(simple_input)
        else:
            if rest_list[target] is None: rest_list[target] = []
            extend_at(path, index+1, simple_input, rest_list[target])
    all = []
    for i in range(input.BranchCount):
        path = input.Path(i)
        extend_at(path, 0, input.Branch(path), all)
    return retrieve_base(all)
    
geometry = tree_to_list(geometry, lambda x: x)



for b in xrange(len(geometry)):
    for s in xrange(len(geometry[b])):
        print b,s
        for p in xrange(geometry[b][s].Count):
            print geometry[b][s].X[p],geometry[b][s].Y[p],geometry[b][s].Z[p]
# ---------- end python ----------
zones_with_materials = Data(createhbzones_3.HBZone)
hbzones = Data(zones_with_materials)
hbzones_2 = Data(hbzones)
path_6 = FilePath(path)
getepschedules = Honeybee_GetEnergyPlusSchedules()  # -> occupancySchedule, occupancyActivitySch, heatingSetPtSchedule, coolingSetPtSchedule, lightingSchedule, equipmentSchedule, infiltrationSchedule; plug-in component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
hbzones_3 = Data(hbzones)
climate_file_2 = Text(climate_file)
path_7 = FilePath(path)
climate_file_3 = Text(climate_file)
panel_7 = Panel(callfromepschlibrary.scheduleList)
path_8 = FilePath(path)
citysim_loadresults = Honeybee_CitySimLoadResults(path=path_6, name=name, HBZones=flatten(hbzones_2), Run=Toggle(False))  # -> SW, Surfaces; plug-in component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
panel_8 = Panel("""ALWAYS ON
ALWAYS ON DEFAULT SCHEDULE
ALWAYS ON SUMMER DESIGN DAY
ALWAYS ON WINTER DESIGN DAY
FULLSERVICERESTAURANT ACTIVITY
FULLSERVICERESTAURANT ACTIVITY DEFAULT SCHEDULE
FULLSERVICERESTAURANT ACTIVITY SUMMER DESIGN DAY
FULLSERVICERESTAURANT ACTIVITY WINTER DESIGN DAY
FULLSERVICERESTAURANT BLDG EQUIP
FULLSERVICERESTAURANT BLDG EQUIP DEFAULT SCHEDULE
FULLSERVICERESTAURANT BLDG EQUIP RULE 1 DAY SCHEDULE
FULLSERVICERESTAURANT BLDG EQUIP SUMMER DESIGN DAY
FULLSERVICERESTAURANT BLDG EQUIP WINTER DESIGN DAY
FULLSERVICERESTAURANT BLDG LIGHT
FULLSERVICERESTAURANT BLDG LIGHT DEFAULT SCHEDULE
FULLSERVICERESTAURANT BLDG LIGHT SUMMER DESIGN DAY
FULLSERVICERESTAURANT BLDG LIGHT WINTER DESIGN DAY
FULLSERVICERESTAURANT BLDG OCC
FULLSERVICERESTAURANT BLDG OCC DEFAULT SCHEDULE
FULLSERVICERESTAURANT BLDG OCC RULE 1 DAY SCHEDULE
FULLSERVICERESTAURANT BLDG OCC RULE 2 DAY SCHEDULE
FULLSERVICERESTAURANT BLDG OCC SUMMER DESIGN DAY
FULLSERVICERESTAURANT BLDG OCC WINTER DESIGN DAY
FULLSERVICERESTAURANT CLGSETP
FULLSERVICERESTAURANT CLGSETP DEFAULT SCHEDULE
FULLSERVICERESTAURANT CLGSETP KITCHEN
FULLSERVICERESTAURANT CLGSETP KITCHEN DEFAULT SCHEDULE
FULLSERVICERESTAURANT CLGSETP KITCHEN SUMMER DESIGN DAY
FULLSERVICERESTAURANT CLGSETP KITCHEN WINTER DESIGN DAY
FULLSERVICERESTAURANT CLGSETP SUMMER DESIGN DAY
FULLSERVICERESTAURANT CLGSETP WINTER DESIGN DAY
FULLSERVICERESTAURANT GAS EQUIP
FULLSERVICERESTAURANT GAS EQUIP DEFAULT SCHEDULE
FULLSERVICERESTAURANT GAS EQUIP RULE 1 DAY SCHEDULE
FULLSERVICERESTAURANT GAS EQUIP SUMMER DESIGN DAY
FULLSERVICERESTAURANT GAS EQUIP WINTER DESIGN DAY
FULLSERVICERESTAURANT HTGSETP
FULLSERVICERESTAURANT HTGSETP DEFAULT SCHEDULE
FULLSERVICERESTAURANT HTGSETP KITCHEN
FULLSERVICERESTAURANT HTGSETP KITCHEN DEFAULT SCHEDULE
FULLSERVICERESTAURANT HTGSETP KITCHEN SUMMER DESIGN DAY
FULLSERVICERESTAURANT HTGSETP KITCHEN WINTER DESIGN DAY
FULLSERVICERESTAURANT HTGSETP SUMMER DESIGN DAY
FULLSERVICERESTAURANT HTGSETP WINTER DESIGN DAY
FULLSERVICERESTAURANT INFIL HALF ON
FULLSERVICERESTAURANT INFIL HALF ON DEFAULT SCHEDULE
FULLSERVICERESTAURANT INFIL HALF ON RULE 1 DAY SCHEDULE
FULLSERVICERESTAURANT INFIL HALF ON RULE 2 DAY SCHEDULE
FULLSERVICERESTAURANT INFIL HALF ON SUMMER DESIGN DAY
FULLSERVICERESTAURANT INFIL HALF ON WINTER DESIGN DAY
HOSPITAL ACTIVITY
HOSPITAL ACTIVITY DEFAULT SCHEDULE
HOSPITAL ACTIVITY SUMMER DESIGN DAY
HOSPITAL ACTIVITY WINTER DESIGN DAY
HOSPITAL BLDG CLGSETP
HOSPITAL BLDG CLGSETP DEFAULT SCHEDULE
HOSPITAL BLDG CLGSETP RULE 1 DAY SCHEDULE
HOSPITAL BLDG CLGSETP SUMMER DESIGN DAY
HOSPITAL BLDG CLGSETP WINTER DESIGN DAY
HOSPITAL BLDG EQUIP
HOSPITAL BLDG EQUIP DEFAULT SCHEDULE
HOSPITAL BLDG EQUIP RULE 1 DAY SCHEDULE
HOSPITAL BLDG EQUIP RULE 2 DAY SCHEDULE
HOSPITAL BLDG EQUIP SUMMER DESIGN DAY
HOSPITAL BLDG EQUIP WINTER DESIGN DAY
HOSPITAL BLDG HTGSETP
HOSPITAL BLDG HTGSETP DEFAULT SCHEDULE
HOSPITAL BLDG HTGSETP RULE 1 DAY SCHEDULE
HOSPITAL BLDG HTGSETP SUMMER DESIGN DAY
HOSPITAL BLDG HTGSETP WINTER DESIGN DAY
HOSPITAL BLDG LIGHT
HOSPITAL BLDG LIGHT DEFAULT SCHEDULE
HOSPITAL BLDG LIGHT RULE 1 DAY SCHEDULE
HOSPITAL BLDG LIGHT RULE 2 DAY SCHEDULE
HOSPITAL BLDG LIGHT SUMMER DESIGN DAY
HOSPITAL BLDG LIGHT WINTER DESIGN DAY
HOSPITAL BLDG OCC
HOSPITAL BLDG OCC DEFAULT SCHEDULE
HOSPITAL BLDG OCC RULE 1 DAY SCHEDULE
HOSPITAL BLDG OCC RULE 2 DAY SCHEDULE
HOSPITAL BLDG OCC SUMMER DESIGN DAY
HOSPITAL BLDG OCC WINTER DESIGN DAY
HOSPITAL CRITICAL CLGSETP
HOSPITAL CRITICAL CLGSETP DEFAULT SCHEDULE
HOSPITAL CRITICAL CLGSETP SUMMER DESIGN DAY
HOSPITAL CRITICAL CLGSETP WINTER DESIGN DAY
HOSPITAL CRITICAL HTGSETP
HOSPITAL CRITICAL HTGSETP DEFAULT SCHEDULE
HOSPITAL CRITICAL HTGSETP SUMMER DESIGN DAY
HOSPITAL CRITICAL HTGSETP WINTER DESIGN DAY
HOSPITAL CRITICAL OCC
HOSPITAL CRITICAL OCC DEFAULT SCHEDULE
HOSPITAL CRITICAL OCC RULE 1 DAY SCHEDULE
HOSPITAL CRITICAL OCC RULE 2 DAY SCHEDULE
HOSPITAL CRITICAL OCC SUMMER DESIGN DAY
HOSPITAL CRITICAL OCC WINTER DESIGN DAY
HOSPITAL INFIL QUARTER ON
HOSPITAL INFIL QUARTER ON DEFAULT SCHEDULE
HOSPITAL INFIL QUARTER ON RULE 1 DAY SCHEDULE
HOSPITAL INFIL QUARTER ON RULE 2 DAY SCHEDULE
HOSPITAL INFIL QUARTER ON SUMMER DESIGN DAY
HOSPITAL INFIL QUARTER ON WINTER DESIGN DAY
HOSPITAL KITCHEN GAS
HOSPITAL KITCHEN GAS DEFAULT SCHEDULE
HOSPITAL KITCHEN GAS RULE 1 DAY SCHEDULE
HOSPITAL KITCHEN GAS SUMMER DESIGN DAY
HOSPITAL KITCHEN GAS WINTER DESIGN DAY
LARGE OFFICE ACTIVITY
LARGE OFFICE ACTIVITY DEFAULT SCHEDULE
LARGE OFFICE ACTIVITY SUMMER DESIGN DAY
LARGE OFFICE ACTIVITY WINTER DESIGN DAY
LARGE OFFICE BLDG EQUIP
LARGE OFFICE BLDG EQUIP DEFAULT SCHEDULE
LARGE OFFICE BLDG EQUIP RULE 1 DAY SCHEDULE
LARGE OFFICE BLDG EQUIP RULE 2 DAY SCHEDULE
LARGE OFFICE BLDG EQUIP SUMMER DESIGN DAY
LARGE OFFICE BLDG EQUIP WINTER DESIGN DAY
LARGE OFFICE BLDG LIGHT
LARGE OFFICE BLDG LIGHT DEFAULT SCHEDULE
LARGE OFFICE BLDG LIGHT RULE 1 DAY SCHEDULE
LARGE OFFICE BLDG LIGHT RULE 2 DAY SCHEDULE
LARGE OFFICE BLDG LIGHT SUMMER DESIGN DAY
LARGE OFFICE BLDG LIGHT WINTER DESIGN DAY
LARGE OFFICE BLDG OCC
LARGE OFFICE BLDG OCC DEFAULT SCHEDULE
LARGE OFFICE BLDG OCC RULE 1 DAY SCHEDULE
LARGE OFFICE BLDG OCC RULE 2 DAY SCHEDULE
LARGE OFFICE BLDG OCC SUMMER DESIGN DAY
LARGE OFFICE BLDG OCC WINTER DESIGN DAY
LARGE OFFICE CLGSETP
LARGE OFFICE CLGSETP DEFAULT SCHEDULE
LARGE OFFICE CLGSETP RULE 1 DAY SCHEDULE
LARGE OFFICE CLGSETP RULE 2 DAY SCHEDULE
LARGE OFFICE CLGSETP SUMMER DESIGN DAY
LARGE OFFICE CLGSETP WINTER DESIGN DAY
LARGE OFFICE HTGSETP
LARGE OFFICE HTGSETP DEFAULT SCHEDULE
LARGE OFFICE HTGSETP RULE 1 DAY SCHEDULE
LARGE OFFICE HTGSETP RULE 2 DAY SCHEDULE
LARGE OFFICE HTGSETP SUMMER DESIGN DAY
LARGE OFFICE HTGSETP WINTER DESIGN DAY
LARGE OFFICE INFIL QUARTER ON
LARGE OFFICE INFIL QUARTER ON DEFAULT SCHEDULE
LARGE OFFICE INFIL QUARTER ON RULE 1 DAY SCHEDULE
LARGE OFFICE INFIL QUARTER ON RULE 2 DAY SCHEDULE
LARGE OFFICE INFIL QUARTER ON SUMMER DESIGN DAY
LARGE OFFICE INFIL QUARTER ON WINTER DESIGN DAY
LARGEHOTEL ACTIVITY
LARGEHOTEL ACTIVITY DEFAULT SCHEDULE
LARGEHOTEL ACTIVITY SUMMER DESIGN DAY
LARGEHOTEL ACTIVITY WINTER DESIGN DAY
LARGEHOTEL BLDG EQUIP
LARGEHOTEL BLDG EQUIP DEFAULT SCHEDULE
LARGEHOTEL BLDG EQUIP RULE 1 DAY SCHEDULE
LARGEHOTEL BLDG EQUIP RULE 2 DAY SCHEDULE
LARGEHOTEL BLDG EQUIP SUMMER DESIGN DAY
LARGEHOTEL BLDG EQUIP WINTER DESIGN DAY
LARGEHOTEL BLDG LIGHT
LARGEHOTEL BLDG LIGHT DEFAULT SCHEDULE
LARGEHOTEL BLDG LIGHT RULE 1 DAY SCHEDULE
LARGEHOTEL BLDG LIGHT RULE 2 DAY SCHEDULE
LARGEHOTEL BLDG LIGHT SUMMER DESIGN DAY
LARGEHOTEL BLDG LIGHT WINTER DESIGN DAY
LARGEHOTEL BLDG OCC
LARGEHOTEL BLDG OCC DEFAULT SCHEDULE
LARGEHOTEL BLDG OCC RULE 1 DAY SCHEDULE
LARGEHOTEL BLDG OCC RULE 2 DAY SCHEDULE
LARGEHOTEL BLDG OCC SUMMER DESIGN DAY
LARGEHOTEL BLDG OCC WINTER DESIGN DAY
LARGEHOTEL CLGSETP
LARGEHOTEL CLGSETP DEFAULT SCHEDULE
LARGEHOTEL CLGSETP SUMMER DESIGN DAY
LARGEHOTEL CLGSETP WINTER DESIGN DAY
LARGEHOTEL CORRIDOR CLGSETP
LARGEHOTEL CORRIDOR CLGSETP DEFAULT SCHEDULE
LARGEHOTEL CORRIDOR CLGSETP SUMMER DESIGN DAY
LARGEHOTEL CORRIDOR CLGSETP WINTER DESIGN DAY
LARGEHOTEL CORRIDOR HTGSETP
LARGEHOTEL CORRIDOR HTGSETP DEFAULT SCHEDULE
LARGEHOTEL CORRIDOR HTGSETP SUMMER DESIGN DAY
LARGEHOTEL CORRIDOR HTGSETP WINTER DESIGN DAY
LARGEHOTEL GUESTROOM CLGSETP
LARGEHOTEL GUESTROOM CLGSETP DEFAULT SCHEDULE
LARGEHOTEL GUESTROOM CLGSETP SUMMER DESIGN DAY
LARGEHOTEL GUESTROOM CLGSETP WINTER DESIGN DAY
LARGEHOTEL GUESTROOM EQUIP
LARGEHOTEL GUESTROOM EQUIP DEFAULT SCHEDULE
LARGEHOTEL GUESTROOM EQUIP RULE 1 DAY SCHEDULE
LARGEHOTEL GUESTROOM EQUIP SUMMER DESIGN DAY
LARGEHOTEL GUESTROOM EQUIP WINTER DESIGN DAY
LARGEHOTEL GUESTROOM HTGSETP
LARGEHOTEL GUESTROOM HTGSETP DEFAULT SCHEDULE
LARGEHOTEL GUESTROOM HTGSETP SUMMER DESIGN DAY
LARGEHOTEL GUESTROOM HTGSETP WINTER DESIGN DAY
LARGEHOTEL GUESTROOM OCC
LARGEHOTEL GUESTROOM OCC DEFAULT SCHEDULE
LARGEHOTEL GUESTROOM OCC RULE 1 DAY SCHEDULE
LARGEHOTEL GUESTROOM OCC SUMMER DESIGN DAY
LARGEHOTEL GUESTROOM OCC WINTER DESIGN DAY
LARGEHOTEL HTGSETP
LARGEHOTEL HTGSETP DEFAULT SCHEDULE
LARGEHOTEL HTGSETP SUMMER DESIGN DAY
LARGEHOTEL HTGSETP WINTER DESIGN DAY
LARGEHOTEL INFIL QUARTER ON
LARGEHOTEL INFIL QUARTER ON DEFAULT SCHEDULE
LARGEHOTEL INFIL QUARTER ON SUMMER DESIGN DAY
LARGEHOTEL INFIL QUARTER ON WINTER DESIGN DAY
LARGEHOTEL KITCHEN CLGSETP
LARGEHOTEL KITCHEN CLGSETP DEFAULT SCHEDULE
LARGEHOTEL KITCHEN CLGSETP SUMMER DESIGN DAY
LARGEHOTEL KITCHEN CLGSETP WINTER DESIGN DAY
LARGEHOTEL KITCHEN EQUIP
LARGEHOTEL KITCHEN EQUIP DEFAULT SCHEDULE
LARGEHOTEL KITCHEN EQUIP RULE 1 DAY SCHEDULE
LARGEHOTEL KITCHEN EQUIP SUMMER DESIGN DAY
LARGEHOTEL KITCHEN EQUIP WINTER DESIGN DAY
LARGEHOTEL KITCHEN GAS
LARGEHOTEL KITCHEN GAS DEFAULT SCHEDULE
LARGEHOTEL KITCHEN GAS RULE 1 DAY SCHEDULE
LARGEHOTEL KITCHEN GAS SUMMER DESIGN DAY
LARGEHOTEL KITCHEN GAS WINTER DESIGN DAY
LARGEHOTEL KITCHEN HTGSETP
LARGEHOTEL KITCHEN HTGSETP DEFAULT SCHEDULE
LARGEHOTEL KITCHEN HTGSETP SUMMER DESIGN DAY
LARGEHOTEL KITCHEN HTGSETP WINTER DESIGN DAY
LARGEHOTEL LAUNDRYROOM EQUIP
LARGEHOTEL LAUNDRYROOM EQUIP DEFAULT SCHEDULE
LARGEHOTEL LAUNDRYROOM EQUIP SUMMER DESIGN DAY
LARGEHOTEL LAUNDRYROOM EQUIP WINTER DESIGN DAY
LARGEHOTEL LAUNDRYROOM GAS
LARGEHOTEL LAUNDRYROOM GAS DEFAULT SCHEDULE
LARGEHOTEL LAUNDRYROOM GAS SUMMER DESIGN DAY
LARGEHOTEL LAUNDRYROOM GAS WINTER DESIGN DAY
MEDIUM OFFICE ACTIVITY
MEDIUM OFFICE ACTIVITY DEFAULT SCHEDULE
MEDIUM OFFICE ACTIVITY SUMMER DESIGN DAY
MEDIUM OFFICE ACTIVITY WINTER DESIGN DAY
MEDIUM OFFICE BLDG EQUIP
MEDIUM OFFICE BLDG EQUIP DEFAULT SCHEDULE
MEDIUM OFFICE BLDG EQUIP RULE 1 DAY SCHEDULE
MEDIUM OFFICE BLDG EQUIP RULE 2 DAY SCHEDULE
MEDIUM OFFICE BLDG EQUIP SUMMER DESIGN DAY
MEDIUM OFFICE BLDG EQUIP WINTER DESIGN DAY
MEDIUM OFFICE BLDG OCC
MEDIUM OFFICE BLDG OCC DEFAULT SCHEDULE
MEDIUM OFFICE BLDG OCC RULE 1 DAY SCHEDULE
MEDIUM OFFICE BLDG OCC RULE 2 DAY SCHEDULE
MEDIUM OFFICE BLDG OCC SUMMER DESIGN DAY
MEDIUM OFFICE BLDG OCC WINTER DESIGN DAY
MEDIUM OFFICE CLGSETP
MEDIUM OFFICE CLGSETP DEFAULT SCHEDULE
MEDIUM OFFICE CLGSETP RULE 1 DAY SCHEDULE
MEDIUM OFFICE CLGSETP RULE 2 DAY SCHEDULE
MEDIUM OFFICE CLGSETP SUMMER DESIGN DAY
MEDIUM OFFICE CLGSETP WINTER DESIGN DAY
MEDIUM OFFICE HTGSETP
MEDIUM OFFICE HTGSETP DEFAULT SCHEDULE
MEDIUM OFFICE HTGSETP RULE 1 DAY SCHEDULE
MEDIUM OFFICE HTGSETP RULE 2 DAY SCHEDULE
MEDIUM OFFICE HTGSETP SUMMER DESIGN DAY
MEDIUM OFFICE HTGSETP WINTER DESIGN DAY
MEDIUM OFFICE INFIL QUARTER ON
MEDIUM OFFICE INFIL QUARTER ON DEFAULT SCHEDULE
MEDIUM OFFICE INFIL QUARTER ON RULE 1 DAY SCHEDULE
MEDIUM OFFICE INFIL QUARTER ON RULE 2 DAY SCHEDULE
MEDIUM OFFICE INFIL QUARTER ON SUMMER DESIGN DAY
MEDIUM OFFICE INFIL QUARTER ON WINTER DESIGN DAY
MIDRISEAPARTMENT ACTIVITY
MIDRISEAPARTMENT ACTIVITY DEFAULT SCHEDULE
MIDRISEAPARTMENT ACTIVITY SUMMER DESIGN DAY
MIDRISEAPARTMENT ACTIVITY WINTER DESIGN DAY
MIDRISEAPARTMENT APARTMENT CLGSETP
MIDRISEAPARTMENT APARTMENT CLGSETP DEFAULT SCHEDULE
MIDRISEAPARTMENT APARTMENT EQUIP
MIDRISEAPARTMENT APARTMENT EQUIP DEFAULT SCHEDULE
MIDRISEAPARTMENT APARTMENT EQUIP SUMMER DESIGN DAY
MIDRISEAPARTMENT APARTMENT EQUIP WINTER DESIGN DAY
MIDRISEAPARTMENT APARTMENT HTGSETP
MIDRISEAPARTMENT APARTMENT HTGSETP DEFAULT SCHEDULE
MIDRISEAPARTMENT APARTMENT LIGHT
MIDRISEAPARTMENT APARTMENT LIGHT DEFAULT SCHEDULE
MIDRISEAPARTMENT APARTMENT LIGHT SUMMER DESIGN DAY
MIDRISEAPARTMENT APARTMENT LIGHT WINTER DESIGN DAY
MIDRISEAPARTMENT APARTMENT OCC
MIDRISEAPARTMENT APARTMENT OCC DEFAULT SCHEDULE
MIDRISEAPARTMENT APARTMENT OCC SUMMER DESIGN DAY
MIDRISEAPARTMENT APARTMENT OCC WINTER DESIGN DAY
MIDRISEAPARTMENT CORRIDOR LIGHT
MIDRISEAPARTMENT CORRIDOR LIGHT DEFAULT SCHEDULE
MIDRISEAPARTMENT CORRIDOR LIGHT SUMMER DESIGN DAY
MIDRISEAPARTMENT CORRIDOR LIGHT WINTER DESIGN DAY
MIDRISEAPARTMENT INFIL
MIDRISEAPARTMENT INFIL DEFAULT SCHEDULE
MIDRISEAPARTMENT INFIL SUMMER DESIGN DAY
MIDRISEAPARTMENT INFIL WINTER DESIGN DAY
MIDRISEAPARTMENT OFFICE CLGSETP
MIDRISEAPARTMENT OFFICE CLGSETP DEFAULT SCHEDULE
MIDRISEAPARTMENT OFFICE CLGSETP SUMMER DESIGN DAY
MIDRISEAPARTMENT OFFICE CLGSETP WINTER DESIGN DAY
MIDRISEAPARTMENT OFFICE EQUIP
MIDRISEAPARTMENT OFFICE EQUIP DEFAULT SCHEDULE
MIDRISEAPARTMENT OFFICE EQUIP RULE 1 DAY SCHEDULE
MIDRISEAPARTMENT OFFICE EQUIP SUMMER DESIGN DAY
MIDRISEAPARTMENT OFFICE EQUIP WINTER DESIGN DAY
MIDRISEAPARTMENT OFFICE HTGSETP
MIDRISEAPARTMENT OFFICE HTGSETP DEFAULT SCHEDULE
MIDRISEAPARTMENT OFFICE HTGSETP SUMMER DESIGN DAY
MIDRISEAPARTMENT OFFICE HTGSETP WINTER DESIGN DAY
MIDRISEAPARTMENT OFFICE LIGHT
MIDRISEAPARTMENT OFFICE LIGHT DEFAULT SCHEDULE
MIDRISEAPARTMENT OFFICE LIGHT RULE 1 DAY SCHEDULE
MIDRISEAPARTMENT OFFICE LIGHT SUMMER DESIGN DAY
MIDRISEAPARTMENT OFFICE LIGHT WINTER DESIGN DAY
MIDRISEAPARTMENT OFFICE OCC
MIDRISEAPARTMENT OFFICE OCC DEFAULT SCHEDULE
MIDRISEAPARTMENT OFFICE OCC RULE 1 DAY SCHEDULE
MIDRISEAPARTMENT OFFICE OCC SUMMER DESIGN DAY
MIDRISEAPARTMENT OFFICE OCC WINTER DESIGN DAY
OFFICE ACTIVITY
OFFICE ACTIVITY DEFAULT SCHEDULE
OFFICE ACTIVITY SUMMER DESIGN DAY
OFFICE ACTIVITY WINTER DESIGN DAY
OFFICE BLDG EQUIP
OFFICE BLDG EQUIP DEFAULT SCHEDULE
OFFICE BLDG EQUIP RULE 1 DAY SCHEDULE
OFFICE BLDG EQUIP RULE 2 DAY SCHEDULE
OFFICE BLDG EQUIP SUMMER DESIGN DAY
OFFICE BLDG EQUIP WINTER DESIGN DAY
OFFICE BLDG LIGHT
OFFICE BLDG LIGHT DEFAULT SCHEDULE
OFFICE BLDG LIGHT RULE 1 DAY SCHEDULE
OFFICE BLDG LIGHT RULE 2 DAY SCHEDULE
OFFICE BLDG LIGHT SUMMER DESIGN DAY
OFFICE BLDG LIGHT WINTER DESIGN DAY
OFFICE BLDG OCC DEFAULT SCHEDULE
OFFICE BLDG OCC DEFAULT SCHEDULE 1
OFFICE BLDG OCC RULE 1 DAY SCHEDULE
OFFICE BLDG OCC RULE 1 DAY SCHEDULE 1
OFFICE BLDG OCC RULE 2 DAY SCHEDULE
OFFICE BLDG OCC RULE 2 DAY SCHEDULE 1
OFFICE BLDG OCC SUMMER DESIGN DAY
OFFICE BLDG OCC SUMMER DESIGN DAY 1
OFFICE BLDG OCC WINTER DESIGN DAY
OFFICE BLDG OCC WINTER DESIGN DAY 1
OFFICE INFIL QUARTER ON
OFFICE INFIL QUARTER ON DEFAULT SCHEDULE
OFFICE INFIL QUARTER ON RULE 1 DAY SCHEDULE
OFFICE INFIL QUARTER ON RULE 2 DAY SCHEDULE
OFFICE INFIL QUARTER ON SUMMER DESIGN DAY
OFFICE INFIL QUARTER ON WINTER DESIGN DAY
OFFICE MISC OCC
OFFICE WORK OCC
OUTPATIENT ACTIVITY
OUTPATIENT ACTIVITY DEFAULT SCHEDULE
OUTPATIENT ACTIVITY SUMMER DESIGN DAY
OUTPATIENT ACTIVITY WINTER DESIGN DAY
OUTPATIENT BLDG EQUIP
OUTPATIENT BLDG EQUIP DEFAULT SCHEDULE
OUTPATIENT BLDG EQUIP RULE 1 DAY SCHEDULE
OUTPATIENT BLDG EQUIP RULE 2 DAY SCHEDULE
OUTPATIENT BLDG EQUIP SUMMER DESIGN DAY
OUTPATIENT BLDG EQUIP WINTER DESIGN DAY
OUTPATIENT BLDG LIGHT
OUTPATIENT BLDG LIGHT DEFAULT SCHEDULE
OUTPATIENT BLDG LIGHT RULE 1 DAY SCHEDULE
OUTPATIENT BLDG LIGHT RULE 2 DAY SCHEDULE
OUTPATIENT BLDG LIGHT SUMMER DESIGN DAY
OUTPATIENT BLDG LIGHT WINTER DESIGN DAY
OUTPATIENT BLDG OCC
OUTPATIENT BLDG OCC DEFAULT SCHEDULE
OUTPATIENT BLDG OCC RULE 1 DAY SCHEDULE
OUTPATIENT BLDG OCC RULE 2 DAY SCHEDULE
OUTPATIENT BLDG OCC SUMMER DESIGN DAY
OUTPATIENT BLDG OCC WINTER DESIGN DAY
OUTPATIENT CLGSETP
OUTPATIENT CLGSETP DEFAULT SCHEDULE
OUTPATIENT CLGSETP RULE 1 DAY SCHEDULE
OUTPATIENT CLGSETP SUMMER DESIGN DAY
OUTPATIENT CLGSETP WINTER DESIGN DAY
OUTPATIENT HTGSETP
OUTPATIENT HTGSETP DEFAULT SCHEDULE
OUTPATIENT HTGSETP RULE 1 DAY SCHEDULE
OUTPATIENT HTGSETP SUMMER DESIGN DAY
OUTPATIENT HTGSETP WINTER DESIGN DAY
OUTPATIENT INFIL
OUTPATIENT INFIL DEFAULT SCHEDULE
OUTPATIENT INFIL SUMMER DESIGN DAY
OUTPATIENT INFIL WINTER DESIGN DAY
OUTPATIENT OR CLGSETP
OUTPATIENT OR CLGSETP DEFAULT SCHEDULE
OUTPATIENT OR CLGSETP SUMMER DESIGN DAY
OUTPATIENT OR CLGSETP WINTER DESIGN DAY
OUTPATIENT OR HTGSETP
OUTPATIENT OR HTGSETP DEFAULT SCHEDULE
OUTPATIENT OR HTGSETP SUMMER DESIGN DAY
OUTPATIENT OR HTGSETP WINTER DESIGN DAY
PRIMARYSCHOOL ACTIVITY
PRIMARYSCHOOL ACTIVITY DEFAULT SCHEDULE
PRIMARYSCHOOL ACTIVITY SUMMER DESIGN DAY
PRIMARYSCHOOL ACTIVITY WINTER DESIGN DAY
PRIMARYSCHOOL BATHCORRMECHKITCHEN CLGSETP
PRIMARYSCHOOL BATHCORRMECHKITCHEN CLGSETP DEFAULT SCHEDULE
PRIMARYSCHOOL BATHCORRMECHKITCHEN CLGSETP SUMMER DESIGN DAY
PRIMARYSCHOOL BATHCORRMECHKITCHEN CLGSETP WINTER DESIGN DAY
PRIMARYSCHOOL BATHCORRMECHKITCHEN HTGSETP
PRIMARYSCHOOL BATHCORRMECHKITCHEN HTGSETP DEFAULT SCHEDULE
PRIMARYSCHOOL BATHCORRMECHKITCHEN HTGSETP SUMMER DESIGN DAY
PRIMARYSCHOOL BATHCORRMECHKITCHEN HTGSETP WINTER DESIGN DAY
PRIMARYSCHOOL BLDG EQUIP
PRIMARYSCHOOL BLDG EQUIP DEFAULT SCHEDULE
PRIMARYSCHOOL BLDG EQUIP RULE 1 DAY SCHEDULE
PRIMARYSCHOOL BLDG EQUIP RULE 2 DAY SCHEDULE
PRIMARYSCHOOL BLDG EQUIP RULE 3 DAY SCHEDULE
PRIMARYSCHOOL BLDG EQUIP RULE 4 DAY SCHEDULE
PRIMARYSCHOOL BLDG EQUIP RULE 5 DAY SCHEDULE
PRIMARYSCHOOL BLDG EQUIP SUMMER DESIGN DAY
PRIMARYSCHOOL BLDG EQUIP WINTER DESIGN DAY
PRIMARYSCHOOL BLDG LIGHT
PRIMARYSCHOOL BLDG LIGHT DEFAULT SCHEDULE
PRIMARYSCHOOL BLDG LIGHT RULE 1 DAY SCHEDULE
PRIMARYSCHOOL BLDG LIGHT RULE 2 DAY SCHEDULE
PRIMARYSCHOOL BLDG LIGHT RULE 3 DAY SCHEDULE
PRIMARYSCHOOL BLDG LIGHT RULE 4 DAY SCHEDULE
PRIMARYSCHOOL BLDG LIGHT RULE 5 DAY SCHEDULE
PRIMARYSCHOOL BLDG LIGHT SUMMER DESIGN DAY
PRIMARYSCHOOL BLDG LIGHT WINTER DESIGN DAY
PRIMARYSCHOOL BLDG OCC
PRIMARYSCHOOL BLDG OCC DEFAULT SCHEDULE
PRIMARYSCHOOL BLDG OCC RULE 1 DAY SCHEDULE
PRIMARYSCHOOL BLDG OCC RULE 2 DAY SCHEDULE
PRIMARYSCHOOL BLDG OCC RULE 3 DAY SCHEDULE
PRIMARYSCHOOL BLDG OCC RULE 4 DAY SCHEDULE
PRIMARYSCHOOL BLDG OCC RULE 5 DAY SCHEDULE
PRIMARYSCHOOL BLDG OCC SUMMER DESIGN DAY
PRIMARYSCHOOL BLDG OCC WINTER DESIGN DAY
PRIMARYSCHOOL CAFETERIA OCC
PRIMARYSCHOOL CAFETERIA OCC DEFAULT SCHEDULE
PRIMARYSCHOOL CAFETERIA OCC RULE 1 DAY SCHEDULE
PRIMARYSCHOOL CAFETERIA OCC RULE 2 DAY SCHEDULE
PRIMARYSCHOOL CAFETERIA OCC RULE 3 DAY SCHEDULE
PRIMARYSCHOOL CAFETERIA OCC RULE 4 DAY SCHEDULE
PRIMARYSCHOOL CAFETERIA OCC RULE 5 DAY SCHEDULE
PRIMARYSCHOOL CAFETERIA OCC SUMMER DESIGN DAY
PRIMARYSCHOOL CAFETERIA OCC WINTER DESIGN DAY
PRIMARYSCHOOL CLGSETP
PRIMARYSCHOOL CLGSETP DEFAULT SCHEDULE
PRIMARYSCHOOL CLGSETP RULE 1 DAY SCHEDULE
PRIMARYSCHOOL CLGSETP RULE 2 DAY SCHEDULE
PRIMARYSCHOOL CLGSETP SUMMER DESIGN DAY
PRIMARYSCHOOL CLGSETP WINTER DESIGN DAY
PRIMARYSCHOOL GYM OCC
PRIMARYSCHOOL GYM OCC DEFAULT SCHEDULE
PRIMARYSCHOOL GYM OCC RULE 1 DAY SCHEDULE
PRIMARYSCHOOL GYM OCC RULE 2 DAY SCHEDULE
PRIMARYSCHOOL GYM OCC RULE 3 DAY SCHEDULE
PRIMARYSCHOOL GYM OCC RULE 4 DAY SCHEDULE
PRIMARYSCHOOL GYM OCC RULE 5 DAY SCHEDULE
PRIMARYSCHOOL GYM OCC SUMMER DESIGN DAY
PRIMARYSCHOOL GYM OCC WINTER DESIGN DAY
PRIMARYSCHOOL HTGSETP
PRIMARYSCHOOL HTGSETP DEFAULT SCHEDULE
PRIMARYSCHOOL HTGSETP RULE 1 DAY SCHEDULE
PRIMARYSCHOOL HTGSETP RULE 2 DAY SCHEDULE
PRIMARYSCHOOL HTGSETP SUMMER DESIGN DAY
PRIMARYSCHOOL HTGSETP WINTER DESIGN DAY
PRIMARYSCHOOL INFIL
PRIMARYSCHOOL INFIL DEFAULT SCHEDULE
PRIMARYSCHOOL INFIL SUMMER DESIGN DAY
PRIMARYSCHOOL INFIL WINTER DESIGN DAY
PRIMARYSCHOOL KITCHEN EQUIP
PRIMARYSCHOOL KITCHEN EQUIP DEFAULT SCHEDULE
PRIMARYSCHOOL KITCHEN EQUIP RULE 1 DAY SCHEDULE
PRIMARYSCHOOL KITCHEN EQUIP RULE 2 DAY SCHEDULE
PRIMARYSCHOOL KITCHEN EQUIP RULE 3 DAY SCHEDULE
PRIMARYSCHOOL KITCHEN EQUIP RULE 4 DAY SCHEDULE
PRIMARYSCHOOL KITCHEN EQUIP RULE 5 DAY SCHEDULE
PRIMARYSCHOOL KITCHEN EQUIP SUMMER DESIGN DAY
PRIMARYSCHOOL KITCHEN EQUIP WINTER DESIGN DAY
PRIMARYSCHOOL KITCHEN GAS
PRIMARYSCHOOL KITCHEN GAS DEFAULT SCHEDULE
PRIMARYSCHOOL KITCHEN GAS RULE 1 DAY SCHEDULE
PRIMARYSCHOOL KITCHEN GAS RULE 2 DAY SCHEDULE
PRIMARYSCHOOL KITCHEN GAS RULE 3 DAY SCHEDULE
PRIMARYSCHOOL KITCHEN GAS RULE 4 DAY SCHEDULE
PRIMARYSCHOOL KITCHEN GAS RULE 5 DAY SCHEDULE
PRIMARYSCHOOL KITCHEN GAS SUMMER DESIGN DAY
PRIMARYSCHOOL KITCHEN GAS WINTER DESIGN DAY
QUICKSERVICERESTAURANT ACTIVITY
QUICKSERVICERESTAURANT ACTIVITY DEFAULT SCHEDULE
QUICKSERVICERESTAURANT ACTIVITY SUMMER DESIGN DAY
QUICKSERVICERESTAURANT ACTIVITY WINTER DESIGN DAY
QUICKSERVICERESTAURANT BLDG EQUIP
QUICKSERVICERESTAURANT BLDG EQUIP DEFAULT SCHEDULE
QUICKSERVICERESTAURANT BLDG EQUIP RULE 1 DAY SCHEDULE
QUICKSERVICERESTAURANT BLDG EQUIP SUMMER DESIGN DAY
QUICKSERVICERESTAURANT BLDG EQUIP WINTER DESIGN DAY
QUICKSERVICERESTAURANT BLDG LIGHT
QUICKSERVICERESTAURANT BLDG LIGHT DEFAULT SCHEDULE
QUICKSERVICERESTAURANT BLDG LIGHT SUMMER DESIGN DAY
QUICKSERVICERESTAURANT BLDG LIGHT WINTER DESIGN DAY
QUICKSERVICERESTAURANT BLDG OCC
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""")
citysim_runsimulation = Honeybee_CitySimRunSimulation(
    HBZones=flatten(hbzones_3),
    Windows=panel_6,
    path=path_7,
    name=name,
    climatefile=climate_file_2,
    Solver="C:\CitySimd.exe",
    Write=Toggle(True),
    Run=Toggle(False))  # -> out; plug-in component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

# ---- group: These components do not use HoneyBee zones: they are faster
citysim_loadsolar = Honeybee_CitySimLoadSolar(path=path_8, name="test-solar", geometry=crv, Run=Toggle(False))  # -> results; plug-in component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
citysim_solar = Honeybee_CitySimSolar(
    geometry=crv,
    reflectance=unflatten,
    path=path_8,
    name="test-solar",
    climatefile=climate_file_3,
    Solver="C:\CitySim.exe",
    Write=Toggle(False),
    Run=Toggle(False))  # -> out; plug-in component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

# ----
python_2 = PythonScript()  # -> Out, A
explode = Explode(Curve=citysim_loadresults.Surfaces, Recursive=True)  # -> Segments, simplify(Vertices)
srf_2 = Surface(citysim_loadresults.Surfaces)
lng_2 = ListLength(List=explode.Vertices)
equals = Equality(FirstNumber=lng_2, SecondNumber="5")  # -> simplify(Equality), Inequality
equals_2 = Equality(FirstNumber=lng_2, SecondNumber="4")  # -> simplify(Equality), Inequality
dup_2 = DuplicateData(Data=equals.Equality, Number=lng_2, Order=True)  # -> simplify(Data)
ma = MassAddition(Input=citysim_loadresults.SW)  # -> Result, PartialResults
dup_3 = DuplicateData(Data=equals_2.Equality, Number=lng_2, Order=True)  # -> simplify(Data)
dispatch = Dispatch(List=explode.Vertices, DispatchPattern=dup_2)  # -> ListA, ListB
dispatch_2 = Dispatch(List=explode.Vertices, DispatchPattern=dup_3)  # -> ListA, ListB
division = Division(A=ma.Result, B=1000)
clean_2 = CleanTree(RemoveNulls=True, RemoveInvalid=True, RemoveEmpty=True, Tree=dispatch.ListA)
clean_3 = CleanTree(RemoveNulls=True, RemoveInvalid=True, RemoveEmpty=True, Tree=dispatch_2.ListA)
bnd = Bounds(Numbers=flatten(division))
quad = MeshQuad(CornerA=0, CornerB=1, CornerC=2, CornerD=3)
triangle = MeshTriangle(CornerA=0, CornerB=1, CornerC=2)
dedomain = DeconstructDomain(Domain=bnd)  # -> Start, End
conmesh = ConstructMesh(Vertices=clean_2, Faces=quad)
conmesh_2 = ConstructMesh(Vertices=clean_3, Faces=triangle)
number_slider_3 = Slider(800, range=0..1000)
gradient = Gradient(
    LowerLimit=Slider(0, range=0..100),
    UpperLimit=dedomain.End,
    Parameter=division,
    stops=[0: RGB(0, 0, 255), 0.501: RGB(255, 255, 0), 1: RGB(255, 0, 0)])
mjoin = MeshJoin(Meshes=[conmesh_2, conmesh])
preview_2 = CustomPreview(Geometry=srf_2, Shader=gradient)
mcol = MeshColours(Mesh=simplify(mjoin), Colours=gradient)
